# Grasshopper definition TextInputOutput.ghx (Grasshopper 1.0.7)
# plug-ins: ShapeDiverForGrasshopper

# ---- group: Text input
# Three alternatives to input text.
#   * Text file
#   * URL to text file
#   * Direct text input (up to 10k characters)
text_file_url = DirectTextInput(maxlength=10000)
text_file = ImportText(
    URI=text_file_url,
    maximum_file_size=52428800,
    selected_file_formats="application/json,application/xml,application/x-step,text/csv,text/plain")
text_up_to_10k_chars = DirectTextInput(maxlength=10000)
null = NullItem(Item=text_file)  # -> NullFlags, InvalidFlags, Description
filter = StreamFilter(Gate=null.NullFlags, Stream0=text_file, Stream1=text_up_to_10k_chars)
txt = Text(filter)
txt_2 = Text(txt)

# ---- group: Text processing
# Do something with the text.
# Here we pipe it through to the output,
# and display its length in the 3D viewer.
panel = Panel("characters long")
txt_3 = Text(txt)
len = TextLength(Text=txt_3)
concat = Concatenate(FragmentA="The input text is", FragmentB=len, FragmentC=panel, JoinSeparator=" ")
L = Location(PlaneXY(0, 0, 0))
txt_4 = Text(txt_3)
tag = TextTag3D(Location=L, Text=concat, Size=1, Colour=RGB(110, 144, 255), Justification=5)

# ---- group: Text output
# Direct data outputs are limited to
# ~300kB including overhead.
# They are slightly faster than exports.
# Text exports support up to 512MB
# depending on subscription.
txt_5 = Text(txt_4)
encoding = ValueList({"ASCII", "UTF_8", "UTF_8_NO_BOM"}, selected="UTF_8_NO_BOM")
end_of_line = ValueList({"CRLF", "LF", "CR"}, selected="CRLF")
extension = ValueList({"txt", "g", "gcode", "csv", "xml", "json", "ifc"}, selected="txt")
c_get_utf_8_byte_count = CSharpScript(x=txt_5)  # -> out, A; inputs x: String
# ---------- c_get_utf_8_byte_count: C# usings ----------
using System.Text;
# ---------- c_get_utf_8_byte_count: C# ----------
    A = Encoding.UTF8.GetByteCount(x);
# ---------- end c_get_utf_8_byte_count ----------
larger = LargerThan(FirstNumber=c_get_utf_8_byte_count.A, SecondNumber="395000")  # -> LargerThan, OrEqualTo
filename = DirectTextInput(maxlength=10000, text="export.txt")
exporttxt = TextExportOptions(Extension=extension, EndOfLine=end_of_line, Encoding=encoding, N=False)
filter_2 = StreamFilter(Gate=larger.LargerThan, Stream0=txt_5)
text_output = DirectDataOutput(Data=filter_2)
text_export = DownloadExport(Data=txt_5, Options=exporttxt, Name=filename)
